# Grasshopper definition Sample2 with categories.ghx (Grasshopper 1.0.7)

list = ValueList({"Columns": "OST_Columns", "CurtainWallPanels": "OST_CurtainWallPanels", "DataDevices": "OST_DataDevices", "Furniture": "OST_Furniture", "Floors": "OST_Floors", "Stairs": "OST_Stairs", "Topography": "OST_Topography", "Walls": "OST_Walls", "Windows": "OST_Windows", "GenericModel": "OST_GenericModel"}, selected="Columns")
push_to_bake = Button()
geo = Geometry()
panel = Panel(list)
revit_bake = CSharpScript(
    Geometry=geo,
    RevitCat=list,
    Bake=push_to_bake,
    Reference=["C:\USERS\MBREAU\SOURCE\REPOS\RHINO.INSIDE\AUTODESK\REVIT\bin\Debug 2017\RhinoInside.Revit.dll", "C:\Program Files\Autodesk\Revit 2019\RevitAPIUI.dll", "C:\Program Files\Autodesk\Revit 2019\RevitAPI.dll"])  # -> out; inputs Geometry: list of GeometryBase, RevitCat: String, Bake: Boolean
# ---------- revit_bake: C# usings ----------
using RhinoInside.Revit;
# ---------- revit_bake: C# ----------
    if(Bake)
      Revit.BakeGeometry(Geometry, RevitCat);
# ---------- end revit_bake ----------
panel_2 = Panel(revit_bake)
