# Grasshopper definition Sample2-ANY CATEGORY.ghx (Grasshopper 1.0.7)
# plug-ins: Human

list = ValueList({"Columns": OST_Columns, "CurtainWallPanels": OST_CurtainWallPanels, "DataDevices": OST_DataDevices, "Furniture": OST_Furniture, "Floors": OST_Floors, "Massing": OST_Massing, "Railings": OST_Railings, "Stairs": OST_Stairs, "Topography": OST_Topography, "Walls": OST_Walls, "Windows": OST_Windows, "GenericModel": OST_GenericModel}, selected="Columns")
push_to_bake = Button()
geo = Geometry([<brep referenced from the Rhino model> x2])
dpipeline = DynamicGeometryPipeline(
    LayerFilter="*",
    NameFilter="*",
    GroupByLayer=False,
    GroupByType=False,
    IncludeHidden=True,
    IncludeLocked=True,
    TypeFilter=0,
    enableFullPath=False,
    listenToAttriubtes=True)
revit_bake = CSharpScript(
    Geometry=geo,
    RevitCat=list,
    Bake=push_to_bake,
    Reference=["C:\USERS\MBREAU\RHINO.INSIDE\AUTODESK\REVIT\bin\Release 2019\RhinoInside.Revit.dll", "C:\Program Files\Autodesk\Revit 2019\RevitAPIUI.dll", "C:\Program Files\Autodesk\Revit 2019\RevitAPI.dll"])  # -> out; inputs Geometry: list of GeometryBase, RevitCat: String, Bake: Boolean
# ---------- revit_bake: C# usings ----------
using RhinoInside.Revit;
# ---------- revit_bake: C# ----------
    if(Bake)
      Revit.BakeGeometry(Geometry, RevitCat);
# ---------- end revit_bake ----------
panel = Panel(revit_bake)
