# Grasshopper definition Sample2.ghx (Grasshopper 1.0.7)

geo = Geometry(<brep referenced from the Rhino model>)
list = ValueList({"Generic Models": "OST_GenericModel", "Mass": "OST_Mass", "Columns": "OST_Columns", "Doors": "OST_Doors", "Furniture": "OST_Furniture", "Floors": "OST_Floors", "Parts": "OST_Parts", "Ramps": "OST_Ramps", "Stairs": "OST_Stairs", "Structural Columns": "OST_StructuralColumns", "Structural Connections": "OST_StructuralConnections", "Structural Foundation": "OST_StructuralFoundation", "Structural Framing": "OST_StructuralFraming", "Topography": "OST_Topography", "Walls": "OST_Walls", "Windows": "OST_Windows"}, selected="Generic Models")
push_to_bake = Button()
revit_bake = CSharpScript(
    Geometry=geo,
    Category=list,
    Bake=push_to_bake,
    Reference=["C:\Program Files\Autodesk\Revit 2019\RevitAPIUI.dll", "C:\Program Files\Autodesk\Revit 2019\RevitAPI.dll", "C:\Users\kike.garbo\AppData\Roaming\Autodesk\Revit\Addins\2019\RhinoInside.Revit\RhinoInside.Revit.dll"])  # -> out; inputs Geometry: list of GeometryBase, Category: String, Bake: Boolean
# ---------- revit_bake: C# usings ----------
using RhinoInside.Revit;
using Autodesk.Revit.DB;
# ---------- revit_bake: C# ----------
    if(Bake)
    {
      var builtInCategory = (BuiltInCategory) Enum.Parse(typeof(BuiltInCategory), Category ?? "OST_GenericModel", false);
      Revit.BakeGeometry(Geometry, builtInCategory);
    }
# ---------- end revit_bake ----------
panel = Panel(revit_bake)
