# Grasshopper definition Sample3.ghx (Grasshopper 1.0.7)

surface = Surface(<surface referenced from the Rhino model>)
samples = Slider(20, range=2..50)
live_update = BooleanToggle(False)
update_topography_surface = Button()
mesh_surface = MeshSurface(Surface=surface, UCount=samples, VCount=samples, Overhang=True, Equalize=False)
deconstruct_mesh = DeconstructMesh(Mesh=mesh_surface)  # -> Vertices, Faces, Colours, Normals
gate_or = GateOr(A=live_update, B=update_topography_surface)
topographysurface = CSharpScript(
    Points=deconstruct_mesh.Vertices,
    Update=gate_or,
    Reference=["%APPDATA%\Autodesk\Revit\Addins\2019\RhinoInside.Revit\RhinoInside.Revit.dll", "C:\Program Files\Autodesk\Revit 2019\RevitAPI.dll", "C:\Program Files\Autodesk\Revit 2019\RevitAPIUI.dll"])  # -> out; inputs Points: list of Point3d, Update: Boolean
# ---------- topographysurface: C# usings ----------
using Autodesk.Revit.DB;
using Autodesk.Revit.DB.Architecture;
using RhinoInside.Revit;
# ---------- topographysurface: C# ----------
    if(!Update)
      return;

    var xyz = new List<XYZ>(Points.Count);
    foreach (var p in Points)
      xyz.Add(new XYZ(p.X, p.Y, p.Z));

    Revit.EnqueueAction((doc) => UpdateTopographySurface(doc, xyz));
# ---------- topographysurface: C# additional code ----------
  ElementId topographySurfaceId = ElementId.InvalidElementId;
  void UpdateTopographySurface(Document doc, IList<XYZ> points)
  {
    // Delete previous surface if exists
    try { doc.Delete(topographySurfaceId); }
    catch (Autodesk.Revit.Exceptions.ArgumentException) {}

    // Create a new TopographySurface
    topographySurfaceId = TopographySurface.Create(doc, points).Id;
  }
# ---------- end topographysurface ----------
panel = Panel(topographysurface)
