# Grasshopper definition Sample4.ghx (Grasshopper 1.0.7)

radius = Slider(60, range=10..100)
now_milliseconds = CSharpScript()  # -> MS
# ---------- now_milliseconds: C# ----------
    MS = DateTime.Now.Millisecond;
# ---------- end now_milliseconds ----------
box = Box({Plane=PlaneXY(0, 0, 0), X=Domain(0, 4000), Y=Domain(0, 4000), Z=Domain(0, 4000)})
pop3d = Populate3D(Region=box, Count=Slider(12, range=1..50), Seed=now_milliseconds)
voronoi³ = Voronoi3D(Points=pop3d, Box=box)  # -> Cells, Boundary
edges = BrepEdges(Brep=voronoi³.Cells)  # -> Naked, Interior, NonManifold
pipe = Pipe(Curve=edges.Interior, Radius=radius, Caps=0)
voronoi_structure = Geometry(pipe)
