# Grasshopper definition Python Bake.gh (Grasshopper 1.0.7)

box = Box({Plane=PlaneXY(-28910.25641, -37794.87179, 0), X=Domain(0, 78974.35897), Y=Domain(0, 57820.51282), Z=Domain(0, 38378.92308)})
python = GhPythonScript(G=box, L="TestLayers", B=Toggle(False))  # -> out, a; inputs B: Boolean
# ---------- python: Python ----------
"""Provides a scripting component.
    Inputs:
        G: Geometry to bake
        L: Layer name for bake
        B: Bake Activate
    Output:
        a: The a output variable"""

__author__ = "ScottD"
__version__ = "2019.08.10"

import rhinoscriptsyntax as rs
import scriptcontext
import Rhino


if B:
    
    print(type(G)) #debug message to Python output
    
    #we obtain the reference in the Rhino doc
    doc_object = rs.coercerhinoobject(G, True, True)
    print(type(doc_object))
    
    attributes = doc_object.Attributes
    print('the type of attributes is: ' + str(type(attributes)))     #debug message to Python output

    geometry = doc_object.Geometry
    print('the type of geometry is: ' + str(type(doc_object)))     #debug message to Python output
    
    #we change the scriptcontext
    scriptcontext.doc = Rhino.RhinoDoc.ActiveDoc
    
    #we add both the geometry and the attributes to the Rhino doc
    rhino_brep = scriptcontext.doc.Objects.Add(geometry, attributes)
    print('the Rhino doc ID is: ' + str(rhino_brep))     #debug message to Python output
    
    #we can for example change the layer in Rhino...
    if not rs.IsLayer(L): 
        rs.AddLayer(L)
    rs.ObjectLayer(rhino_brep, L)
    
    #we put back the original Grasshopper document as default
    scriptcontext.doc = ghdoc
    a = G
# ---------- end python ----------
