# Grasshopper definition ghpython-revit.gh (Grasshopper 1.0.7)

python = GhPythonScript(x=Slider(16.021, range=6..20.001), y=Button())  # -> out, a
# ---------- python: Python ----------
"""Provides a scripting component.
    Inputs:
        x: The radius of the sphere
        y: Bake the object if true
    Output:
        a: The a output variable"""

__author__ = "ScottD"
__version__ = "2019.08.05"

import rhinoscriptsyntax as rs
import clr
clr.AddReference('System.Core')
clr.AddReference('RhinoInside.Revit')
clr.AddReference('RevitAPI') 
clr.AddReference('RevitAPIUI')

from System import Action, Func
from System.Linq import Enumerable
from Autodesk.Revit.DB import *
from Rhino import Geometry as Rhino
from RhinoInside.Revit import Revit, Convert

sphere = Rhino.Sphere(Rhino.Point3d.Origin, x * Revit.ModelUnits)

a = sphere

def CommitToDocument(doc):

    brep = sphere.ToBrep()
    meshes = Rhino.Mesh.CreateFromBrep(brep, Rhino.MeshingParameters.Default)

    category = ElementId(BuiltInCategory.OST_GenericModel)
    ds = DirectShape.CreateElement(doc, category)

    for geometry in Enumerable.ToList(Convert.ToHost(meshes)):
        ds.AppendShape(geometry)


if y == True:
    Revit.EnqueueAction(Action[Document](CommitToDocument))
# ---------- end python ----------
