# Grasshopper definition rhino to revit.gh (Grasshopper 1.0.7)
# plug-ins: RhinoInside.Revit

# ---- group: Right-click to select multiple Rhino breps
brep = Brep([<brep referenced from the Rhino model> x4])

# ---- group: Right-click to select multiple points in Rhino
pt = Point([<point referenced from the Rhino model> x6])

# ---- group: Right-click to select multiple courtyard curves in Rhino
crv = Curve([<curve referenced from the Rhino model> x2])

# ---- group: Use a DS Category selector and a DS from geometry component
categories = DirectShapeCategories({"Air Terminals": -2008013, "Bridge Abutments": -2006130, "Bridge Arches": -2006134, "Bridge Bearings": -2006138, "Bridge Cables": -2006133, "Bridge Decks": -2006135, "Bridge Foundations": -2006136, "Bridge Girders": -2006137, "Bridge Piers": -2006131, "Bridge Towers": -2006132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}, selected="Generic Models": -2000151)
bygeometry = AddDirectShapeByGeometry(Geometry=brep, Category=categories)

# ---- group: Revit components
bycurve = AddDirectShapeByCurve(Curve=crv)
bypoint = AddDirectShapeByPoint(Point=pt)
