# Grasshopper definition create revit walls.gh (Grasshopper 1.0.7)
# plug-ins: RhinoInside.Revit

level = DocumentLevelsPicker({"Level 1": 1610}, selected="Level 1")
height_of_walls = Slider(78.894, range=0..101)

# ---- group: Right-click to select a Rhino curve
crv = Curve(<curve referenced from the Rhino model>)

# ---- group: Right-click to select a Revit wall
element = Element(<element referenced from the Revit model>)

# ----
explode = Explode(Curve=crv, Recursive=True)  # -> Segments, Vertices
element_identity = ElementIdentity(Element=element)  # -> Name, Category, Type, UniqueID
bycurve = AddWallByCurve(Axis=explode.Segments, Type=element_identity.Type, Level=level, Structural=True, Height=height_of_walls)
