# Grasshopper definition Sample_Revit_to_Rhino.gh (Grasshopper 1.0.7)
# plug-ins: RhinoInside.Revit

model = DocumentCategoriesPicker({"Air Terminals": -2008013, "Cable Tray Fittings": -2008126, "Cable Trays": -2008130, "Casework": -2001000, "Ceilings": -2000038, "Columns": -2000100, "Communication Devices": -2008081, "Conduit Fittings": -2008128, "Conduits": -2008132, "Curtain Panels": -2000170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}, selected="Floors": -2000032)
model_2 = DocumentCategoriesPicker({"Air Terminals": -2008013, "Cable Tray Fittings": -2008126, "Cable Trays": -2008130, "Casework": -2001000, "Ceilings": -2000038, "Columns": -2000100, "Communication Devices": -2008081, "Conduit Fittings": -2008128, "Conduits": -2008132, "Curtain Panels": -2000170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}, selected="Windows": -2000014)
model_3 = DocumentCategoriesPicker({"Air Terminals": -2008013, "Cable Tray Fittings": -2008126, "Cable Trays": -2008130, "Casework": -2001000, "Ceilings": -2000038, "Columns": -2000100, "Communication Devices": -2008081, "Conduit Fittings": -2008128, "Conduits": -2008132, "Curtain Panels": -2000170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}, selected="Roofs": -2000035)
model_4 = DocumentCategoriesPicker({"Air Terminals": -2008013, "Cable Tray Fittings": -2008126, "Cable Trays": -2008130, "Casework": -2001000, "Ceilings": -2000038, "Columns": -2000100, "Communication Devices": -2008081, "Conduit Fittings": -2008128, "Conduits": -2008132, "Curtain Panels": -2000170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}, selected="Doors": -2000023)
model_5 = DocumentCategoriesPicker({"Air Terminals": -2008013, "Cable Tray Fittings": -2008126, "Cable Trays": -2008130, "Casework": -2001000, "Ceilings": -2000038, "Columns": -2000100, "Communication Devices": -2008081, "Conduit Fittings": -2008128, "Conduits": -2008132, "Curtain Panels": -2000170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}, selected="Walls": -2000011)
model_6 = DocumentCategoriesPicker({"Air Terminals": -2008013, "Cable Tray Fittings": -2008126, "Cable Trays": -2008130, "Casework": -2001000, "Ceilings": -2000038, "Columns": -2000100, "Communication Devices": -2008081, "Conduit Fittings": -2008128, "Conduits": -2008132, "Curtain Panels": -2000170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}, selected="Curtain Wall Mullions": -2000171)
categories = DocumentCategories(Type=1, AllowsParameters=True, Hidden=False)
value_set_picker = ValueSetPicker(categories)
category_filter = ElementCategoryFilter(Categories=model, Inverted=False)
category_filter_2 = ElementCategoryFilter(Categories=model_3, Inverted=False)
category_filter_3 = ElementCategoryFilter(Categories=model_2, Inverted=False)
category_filter_4 = ElementCategoryFilter(Categories=value_set_picker, Inverted=False)
category_filter_5 = ElementCategoryFilter(Categories=model_5, Inverted=False)
category_filter_6 = ElementCategoryFilter(Categories=model_6, Inverted=False)
category_filter_7 = ElementCategoryFilter(Categories=model_4, Inverted=False)
category_identity = CategoryIdentity(Category=model)  # -> Name, Parent, Type, AllowsParameters, HasMaterialQuantities, Cuttable, Hidden
category_identity_2 = CategoryIdentity(Category=model_2)  # -> Name, Parent, Type, AllowsParameters, HasMaterialQuantities, Cuttable, Hidden
category_identity_3 = CategoryIdentity(Category=model_5)  # -> Name, Parent, Type, AllowsParameters, HasMaterialQuantities, Cuttable, Hidden
category_identity_4 = CategoryIdentity(Category=model_3)  # -> Name, Parent, Type, AllowsParameters, HasMaterialQuantities, Cuttable, Hidden
elements = DocumentElements(Filter=category_filter_3)
elements_2 = DocumentElements(Filter=category_filter_4)
elements_3 = DocumentElements(Filter=category_filter_5)
elements_4 = DocumentElements(Filter=category_filter_2)
elements_5 = DocumentElements(Filter=category_filter_6)
elements_6 = DocumentElements(Filter=category_filter_7)
category_identity_5 = CategoryIdentity(Category=model_6)  # -> Name, Parent, Type, AllowsParameters, HasMaterialQuantities, Cuttable, Hidden
elements_7 = DocumentElements(Filter=category_filter)
category_identity_6 = CategoryIdentity(Category=model_4)  # -> Name, Parent, Type, AllowsParameters, HasMaterialQuantities, Cuttable, Hidden
category_identity_7 = CategoryIdentity(Category=value_set_picker)  # -> Name, Parent, Type, AllowsParameters, HasMaterialQuantities, Cuttable, Hidden
geometry = ElementGeometry(Element=elements_4)
geometry_2 = ElementGeometry(Element=elements_6)
geometry_3 = ElementGeometry(Element=elements_3)
geometry_4 = ElementGeometry(Element=elements_7)
geometry_5 = ElementGeometry(Element=elements_2)
geometry_6 = ElementGeometry(Element=elements)
geometry_7 = ElementGeometry(Element=elements_5)
python = GhPythonScript(G=flatten(geometry_5), L=category_identity_7.Name, B=Button())  # -> out, a; inputs B: Boolean
# ---------- python: Python ----------
"""Provides a scripting component.
    Inputs:
        G: Geometry to bake
        L: Layer name for bake
        B: Bake Activate
    Output:
        a: The a output variable"""

__author__ = "ScottD"
__version__ = "2019.08.10"

import rhinoscriptsyntax as rs
import scriptcontext
import Rhino


scriptcontext.doc = ghdoc


if B:
    
    #debug message to Python output
    print(type(G))
    
    #we obtain the reference in the Rhino doc
    doc_object = rs.coercerhinoobject(G, True, True)
    print(type(doc_object))
    
    attributes = doc_object.Attributes
    print('the type of attributes is: ' + str(type(attributes)))
    geometry = doc_object.Geometry
    print('the type of geometry is: ' + str(type(doc_object)))
    
    #we change the scriptcontext
    scriptcontext.doc = Rhino.RhinoDoc.ActiveDoc
    
    #we add both the geometry and the attributes to the Rhino doc
    rhino_brep = scriptcontext.doc.Objects.Add(geometry, attributes)
    print('the Rhino doc ID is: ' + str(rhino_brep))
    
    #we can for example change color in Rhino...
    # rs.ObjectColor(rhino_line, color)
    if not rs.IsLayer(L): 
        rs.AddLayer(L)
    rs.ObjectLayer(rhino_brep, L)
    
    #we put back the original Grasshopper document as default
    scriptcontext.doc = ghdoc
    a = rhino_brep
# ---------- end python ----------
python_2 = GhPythonScript(G=flatten(geometry_4), L=category_identity.Name, B=Button())  # -> out, a; inputs B: Boolean; same code as python
python_3 = GhPythonScript(G=flatten(geometry_6), L=category_identity_2.Name, B=Button())  # -> out, a; inputs B: Boolean; same code as python
python_4 = GhPythonScript(G=flatten(geometry), L=category_identity_4.Name, B=Button())  # -> out, a; inputs B: Boolean; same code as python
python_5 = GhPythonScript(G=flatten(geometry_7), L=category_identity_5.Name, B=Button())  # -> out, a; inputs B: Boolean; same code as python
python_6 = GhPythonScript(G=flatten(geometry_3), L=category_identity_3.Name, B=Button())  # -> out, a; inputs B: Boolean; same code as python
python_7 = GhPythonScript(G=flatten(geometry_2), L=category_identity_6.Name, B=Button())  # -> out, a; inputs B: Boolean; same code as python
