# Grasshopper definition Sample_Door_Parameter_Script.gh (Grasshopper 1.0.7)
# plug-ins: RhinoInside.Revit

model = DocumentCategoriesPicker({"Air Terminals": -2008013, "Cable Tray Fittings": -2008126, "Cable Trays": -2008130, "Casework": -2001000, "Ceilings": -2000038, "Columns": -2000100, "Communication Devices": -2008081, "Conduit Fittings": -2008128, "Conduits": -2008132, "Curtain Panels": -2000170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}, selected="Doors": -2000023)
category_filter = ElementCategoryFilter(Categories=model, Inverted=False)
elements = DocumentElements(Filter=category_filter)
parameterget = ElementParameterGet(Element=elements, ParameterKey="Mark")
txt = Text(parameterget)
parameterset = ElementParameterSet(Element=elements, ParameterKey="Comments", ParameterValue=txt)
