# Grasshopper definition Sample_Write_Sheet_HumanUI_Script.gh (Grasshopper 1.0.7)
# plug-ins: Human UI, RhinoInside.Revit

annotation = AnnotationCategoriesPicker({"Adaptive Points": -2000900, "Air Terminal Tags": -2008014, "Analytical Beam Tags": -2009649, "Analytical Brace Tags": -2009650, "Analytical Column Tags": -2009651, "Analytical Floor Tags": -2009652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}, selected="Title Blocks": -2000280)

# ---- group: HumanUI
pan = Panel("Drawn By")
pan_2 = Panel("Checked By")
textbox = CreateTextBox(Label=pan, DefaultText="None", UpdateButton=True, showLabel=True)
textbox_2 = CreateTextBox(Label=pan_2, DefaultText="None", UpdateButton=True, showLabel=True)

# ----
category_filter = ElementCategoryFilter(Categories=annotation, Inverted=False)
elements = DocumentElements(Filter=category_filter)

# ---- group: HumanUI
toggle = BooleanToggle(True)
values = ValueListener(Elements=textbox_2, SomeProperty=True)  # -> Values, Indices
values_2 = ValueListener(Elements=textbox, SomeProperty=True)  # -> Values, Indices

# ----
launchwin = LaunchWindow(Show=toggle, Name="Update Revit Sheets", Width=370, Height=200, ChildStatus=0, EnableHorizScroll=False)

# ---- group: HumanUI (continued)
addelems = AddElements(Window=launchwin, Elements=flatten([textbox, textbox_2]), DoVLChecking=True)  # -> AddedElements, ElementNames

# ---- group: Revit Parameters
parameterset = ElementParameterSet(Element=elements, ParameterKey=pan, ParameterValue=values_2.Values)
parameterset_2 = ElementParameterSet(Element=elements, ParameterKey=pan_2, ParameterValue=values.Values)
