# Grasshopper definition revit to rhino sample.gh (Grasshopper 1.0.7)
# plug-ins: RhinoInside.Revit

category = DocumentCategoriesPicker({"Air Terminals": -2008013, "Analysis Display Style": -2000304, "Analysis Results": -2000303, "Areas": -2003200, "Bridge Abutments": -2006130, "Bridge Arches": -2006134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}, selected="Walls": -2000011)
category_2 = DocumentCategoriesPicker({"Air Terminals": -2008013, "Analysis Display Style": -2000304, "Analysis Results": -2000303, "Areas": -2003200, "Bridge Abutments": -2006130, "Bridge Arches": -2006134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}, selected="Roofs": -2000035)
elements = DocumentElements(Category=category)
elements_2 = DocumentElements(Category=category_2)
geometry = ElementGeometry(Element=elements)
geometry_2 = ElementGeometry(Element=elements_2)
