# Grasshopper definition wall_roof.gh (Grasshopper 1.0.7)
# plug-ins: RhinoInside.Revit

edge = Edge(<edge referenced from the Revit model>)
edge_2 = Edge(<edge referenced from the Revit model>)
categories = DirectShapeCategories({"Air Terminals": -2008013, "Bridge Abutments": -2006130, "Bridge Arches": -2006134, "Bridge Bearings": -2006138, "Bridge Cables": -2006133, "Bridge Decks": -2006135, "Bridge Foundations": -2006136, "Bridge Girders": -2006137, "Bridge Piers": -2006131, "Bridge Towers": -2006132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}, selected="Roofs": -2000035)
join = JoinCurves(Curves=edge_2, Preserve=False)
join_2 = JoinCurves(Curves=edge, Preserve=False)
flip = FlipCurve(Curve=join_2)  # -> Curve, Flag
loft = Loft(
    Curves=[join, flip.Curve],
    Options={Adjust=False, Closed=False, LoftEnds=0, LoftSimp=0, LoftType=0, Rebuild=10, Refit=0.01})
bygeometry = AddDirectShapeByGeometry(Category=categories, Geometry=loft)  # disabled
