# Grasshopper definition Curtain Wall in GH.gh (Grasshopper 1.0.7)
# plug-ins: RhinoInside.Revit

arc = Arc(Plane=PlaneXY(0, 0, 0), Radius=20, Angle=Domain(0, 3.141592654))  # -> Arc, Length

# ---- group: Create Curtain Wall from curve
model = ModelCategoriesPicker({"Air Terminals": -2008013, "Cable Tray Fittings": -2008126, "Cable Trays": -2008130, "Casework": -2001000, "Ceilings": -2000038, "Columns": -2000100, "Communication Devices": -2008081, "Conduit Fittings": -2008128, "Conduits": -2008132, "Curtain Panels": -2000170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}, selected="Walls": -2000011)
elementtype_byname = ElementTypeByName(
    model,
    {"Basic Wall : Exterior - Brick and CMU on Mtl. Stud": 12219, "Basic Wall : Exterior - Brick on CMU": 1837, "Basic Wall : Exterior - Brick on Mtl. Stud": 9754, "Basic Wall : Exterior - CMU on Mtl. Stud": 41083, "Basic Wall : Exterior - Clapboard on Wood Stud": 9756, "Basic Wall : Foundation - 12\" Concrete": 1844, "Basic Wall : Foundation - 36\" Footing": 6863, "Basic Wall : Generic - 12": 1838, "Basic Wall : Generic - 12\" Masonry": 1839, "Basic Wall : Generic - 6": 1835, "Basic Wall : Generic - 6\" Masonry": 1841, "Basic Wall : Generic - 8": 1836, "Basic Wall : Generic - 8\" Masonry": 1840, "Basic Wall : Interior - 4 7/8\" Partition (1-hr)": 1842, "Basic Wall : Interior - 6 1/8\" Partition (2-hr)": 1843, "Basic Wall : Retaining - 12\" Concrete": 1845, "Curtain Wall : Curtain Wall": 382, "Curtain Wall : Exterior Glazing": 20632, "Curtain Wall : Storefront": 20633}, selected="Curtain Wall : Curtain Wall")
pick_model_line = GeometricElement(<geometric element referenced from the Revit model>)
geometry = ElementGeometry(Element=pick_model_line)
bycurve = AddWallByCurve(Curve=arc.Arc, Type=elementtype_byname)
parameterset = ElementParameterSet(Element=bycurve, ParameterKey="Unconnected Height", ParameterValue=Slider(12.868, range=8..20))

# ---- group: Set horizontal divisions
builtinparametergroups = BuiltInParameterGroups({"Adaptive Component": -5000172, "Advanced": -5000217, "Analysis Results": -5000161, "Analytical Alignment": -5000191, "Analytical Model": -5000145, "Analytical Properties": -5000192, "Area": -5000166, "Bottom Chords": -5000153, "Building Data": -5000219, "Calculation Rules": -5000196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}, selected="Horizontal Grid": -5000135)
parameters = ElementParameters(Element=parameterset, Name="Number", Group=builtinparametergroups)
parameterset_2 = ElementParameterSet(Element=parameterset, ParameterKey=parameters, ParameterValue=Slider(2, range=1..10))

# ---- group: Set vertical divisions
builtinparametergroups_2 = BuiltInParameterGroups({"Adaptive Component": -5000172, "Advanced": -5000217, "Analysis Results": -5000161, "Analytical Alignment": -5000191, "Analytical Model": -5000145, "Analytical Properties": -5000192, "Area": -5000166, "Bottom Chords": -5000153, "Building Data": -5000219, "Calculation Rules": -5000196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}, selected="Vertical Grid": -5000133)
parameters_2 = ElementParameters(Element=parameterset, Name="Number", Group=builtinparametergroups_2)
parameterset_3 = ElementParameterSet(Element=parameterset, ParameterKey=parameters_2, ParameterValue=Slider(6, range=1..10))

# ---- group: Selecting Curtain Wall Panels
categories = DocumentCategories(Type=1, AllowsParameters=True, Hidden=False)
value_set_picker = ValueSetPicker(categories)
category_filter = ElementCategoryFilter(Categories=value_set_picker, Inverted=False)
elements = DocumentElements(Filter=category_filter)
panel = Panel(elements)
geometry_2 = ElementGeometry(Element=elements)
