# Grasshopper definition Sample4.ghx (Grasshopper 1.0.7)

radius = Slider(60, range=10..100)
now_milliseconds = CSharpScript()  # -> MS
# ---------- now_milliseconds: C# ----------
    MS = DateTime.Now.Millisecond;
# ---------- end now_milliseconds ----------
box = Box({Plane=PlaneXY(0, 0, 0), X=Domain(0, 4000), Y=Domain(0, 4000), Z=Domain(0, 4000)})
pop3d = Populate3D(Region=box, Count=Slider(8, range=1..12), Seed=now_milliseconds)
voronoi³ = Voronoi3D(Points=pop3d, Box=box)  # -> Cells, Boundary
edges = BrepEdges(Brep=voronoi³.Cells)  # -> Naked, flatten(Interior), NonManifold

# ---- group: Remove Duplicates
curve_middle = CurveMiddle(Curve=edges.Interior)
cull_duplicates = CullDuplicates(Points=curve_middle, Tolerance=0.1, CullMode=1)  # -> Points, Indices, Valence
smaller_than = SmallerThan(FirstNumber=cull_duplicates.Valence, SecondNumber=2)  # -> SmallerThan, OrEqualTo
cull_pattern = CullPattern(List=cull_duplicates.Indices, CullPattern=invert(smaller_than.SmallerThan))
cull_index = CullIndex(List=edges.Interior, Indices=cull_pattern, Wrap=True)

# ----
pipe = Pipe(Curve=cull_index, Radius=radius, Caps=0)
voronoi_structure = Geometry(pipe)
