# Grasshopper definition Sample5.ghx (Grasshopper 1.0.7)
# plug-ins: RhinoInside.Revit

edge = Edge(<edge referenced from the Revit model>)
category = DirectShapeCategories({"Air Terminals": -2008013, "Bridge Abutments": -2006130, "Bridge Arches": -2006134, "Bridge Bearings": -2006138, "Bridge Cables": -2006133, "Bridge Decks": -2006135, "Bridge Foundations": -2006136, "Bridge Girders": -2006137, "Bridge Piers": -2006131, "Bridge Towers": -2006132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}, selected="Roofs": -2000035)
edge_2 = Edge(<edge referenced from the Revit model>)
join_curves = JoinCurves(Curves=edge, Preserve=False)
join_curves_2 = JoinCurves(Curves=edge_2, Preserve=False)
flip_curve = FlipCurve(Curve=join_curves)  # -> Curve, Flag
loft = Loft(
    Curves=[join_curves_2, flip_curve.Curve],
    Options={Adjust=False, Closed=False, LoftEnds=0, LoftSimp=0, LoftType=0, Rebuild=10, Refit=0.01})
adddirectshape_bygeometry = AddDirectShapeByGeometry(Geometry=loft, Category=category)
