# Grasshopper definition RiUE_Sample3_RndTerrain.gh (Grasshopper 1.0.7)

number_slider = Slider(1000, range=0..1000)
dom = ConstructDomain(DomainStart=expr("-x/2", number_slider), DomainEnd=expr("x/2", number_slider))
rectangle = Rectangle(Plane=PlaneXY(0, 0, 0), XSize=dom, YSize=dom, Radius=0)  # -> Rectangle, Length
pop2d = Populate2D(Region=rectangle.Rectangle, Count=100, Seed=1)
lng = ListLength(List=pop2d)
dom_2 = ConstructDomain(DomainStart=Slider(-100, range=-100..0), DomainEnd=Slider(100, range=0..100))
random = Random(Range=dom_2, Number=lng, Seed=2)
Z = UnitZ(Factor=random)
addition = Addition(A=pop2d, B=Z)
del = DelaunayMesh(Points=addition, Plane=PlaneXY(0, 0, 0))
subdmesh = SubDFromMesh(Mesh=del, Creases=1, Corners=1, Interpolate=False)
meshsubd = MeshFromSubD(SubD=subdmesh, Density=2)
