# Grasshopper definition callunity.gh (Grasshopper 1.0.7)

brep = Brep([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])
mesh = Mesh(brep)
mjoin = MeshJoin(Meshes=mesh)
scale = Scale(Geometry=mjoin, Center=Point(0, 0, 0), Factor=Slider(1.82, range=0.01..3))  # -> Geometry, Transform
rotate = Rotate(Geometry=scale.Geometry, Angle=Slider(3.67, range=0..6.28), Plane=PlaneXY(0, 0, 0))  # -> Geometry, Transform
c_script = CSharpScript(mesh=rotate.Geometry)  # inputs mesh: Mesh
# ---------- c_script: C# ----------
    using(var args = new Rhino.Runtime.NamedParametersEventArgs())
    {
      args.Set("mesh", mesh);
      Rhino.Runtime.HostUtils.ExecuteNamedCallback("Unity:FromGrasshopper", args);
    }
# ---------- end c_script ----------
