# Grasshopper definition HumanUI_Example.gh (Grasshopper 1.0.7)
# plug-ins: Human UI

# ----
# 2. Create UI Elements
monkeys = Slider(32, range=0..100)
# HUMAN UI: Beginner Examples
# Set the toggle to the right to "True" to launch the window.
pan = Panel("There are no monkeys.")
label = CreateLabel(LabelText=pan, LabelSize=12, Justification=0)

# ----
# Updating a UI Element
# 1. Create a window
toggle = BooleanToggle(True)
launchwin = LaunchWindow(Show=toggle, Name="Control Window", Width=370, Height=400, ChildStatus=0, EnableHorizScroll=False)

slider = CreateSlider(Slider=monkeys, ShowBounds=False, ShowTicks=False, ShowTooltip=False, ShowValLabel=True, showLabel=True)
values = ValueListener(Elements=slider, SomeProperty=True)  # -> Values, Indices

# ----
# 3. Add the element to the window
addelems = AddElements(Window=launchwin, Elements=flatten([label, slider]), DoVLChecking=True)  # -> AddedElements, ElementNames

# ----
# 4. Listen to the UI Elements
panel = Panel(values.Values)

# ----
# 5. Update the contents of existing elements
pan_2 = Panel("There are {0} monkeys.")
format = Format(Format=pan_2, Culture=127, Data0=values.Values)
setlabel = SetLabelContents(LabelToModify=label, NewLabelContents=format)
